# Grasshopper definition 0308AdvancedSimplify00.gh (Grasshopper 1.0.7)

crv = Curve(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)
crv_2 = Curve(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)
crv_3 = Curve(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)
crv_4 = Curve(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)
explode = Explode(Curve=crv_3, Recursive=True)  # -> Segments, Vertices
explode_2 = Explode(Curve=crv_4, Recursive=True)  # -> Segments, Vertices
# found that simplify and discontinuity
# can't solve polyline is twisted
explode_3 = Explode(Curve=crv, Recursive=True)  # -> Segments, Vertices
explode_4 = Explode(Curve=crv_2, Recursive=True)  # -> Segments, Vertices
# Douglas-Peucker algorithm?
simplify = SimplifyCurve(Curve=crv_4)  # -> Curve, Simplified
points = PointList(Points=explode_4.Vertices, Size="25")
points_2 = PointList(Points=explode_2.Vertices, Size="25")
points_3 = PointList(Points=explode_3.Vertices, Size="25")
points_4 = PointList(Points=explode.Vertices, Size="25")
join = JoinCurves(Curves=explode_2.Segments, Preserve=False)
disc = Discontinuity(Curve=crv_4, Level=1)  # -> Points, Parameters
explode_5 = Explode(Curve=simplify.Curve, Recursive=True)  # -> Segments, Vertices
python = GhPythonScript(x=explode.Vertices)  # -> out, a; inputs x: list of Point3d
# ---------- python: Python ----------
__author__ = "SLZ_D03"
__version__ = "2023.03.08"

import rhinoscriptsyntax as rs


newlist = []

newlist.append(x[0])

if(len(x)>=4):
    for i in range (0,len(x)-3):
        if(x[i].Y==x[i+1].Y==x[i+2].Y==x[i+3].Y 
        and x[i].Z==x[i+1].Z==x[i+2].Z==x[i+3].Z):
            continue


newlist.append(x[-1])


a=newlist
# ---------- end python ----------
python_2 = GhPythonScript(x=explode_2.Vertices)  # -> out, a; inputs x: list of Point3d
# ---------- python_2: Python ----------
__author__ = "SLZ_D03"
__version__ = "2023.03.07"

import rhinoscriptsyntax as rs

newlist = []

if(len(x)>=4):
    for i in range (0,len(x)-3):
        if(x[i].Y==x[i+1].Y==x[i+2].Y==x[i+3].Y 
        and x[i].Z==x[i+1].Z==x[i+2].Z==x[i+3].Z):
            newlist.append(x[i])


newlist.append(x[-1])


a=newlist
# ---------- end python_2 ----------
python_3 = GhPythonScript(x=explode_4.Vertices)  # -> out, a; inputs x: list of Point3d; same code as python
c_script = CSharpScript(x=explode_3.Vertices)  # -> out, A; inputs x: list of Point3d
# ---------- c_script: C# ----------
    List<Point3d> p = new List<Point3d>();
    
    p = x;
    
    int N = x.Count - 2;
    
    List<Point3d> OutPt = new List<Point3d>();
    
    Point3d selfTrimmedPtA = new Point3d();
    Point3d selfTrimmedPtB = new Point3d();
    Point3d selfTrimmedPtC = new Point3d();

    for (int i = 0; i < N; i++)
    {
      Point3d aPt = p[i];
      Point3d bPt = p[i + 1];
      Point3d cPt = p[i + 2];

      double aPtX = p[i].X;
      double aPtY = p[i].Y;
      double aPtZ = p[i].Z;
      double bPtX = p[i + 1].X;
      double bPtY = p[i + 1].Y;
      double bPtZ = p[i + 1].Z;
      double cPtX = p[i + 2].X;
      double cPtY = p[i + 2].Y;
      double cPtZ = p[i + 2].Z;

      if (i == N - 2)
      {
        if ((aPtX == bPtX && bPtX == cPtX && aPtY == bPtY && bPtY == cPtY)
          || (aPtY == bPtY && bPtY == cPtY && aPtZ == bPtZ && bPtZ == cPtZ)
          || (aPtZ == bPtZ && bPtZ == cPtZ && aPtX == bPtX && bPtX == cPtX))
        {
          Point3d dPt = p[i + 3];

          selfTrimmedPtA = new Point3d(aPtX, aPtY, aPtZ);
          selfTrimmedPtC = new Point3d(cPtX, cPtY, cPtZ);

          OutPt.Add(selfTrimmedPtA);
          OutPt.Add(selfTrimmedPtC);
          OutPt.Add(dPt);

          i++;
        }
        else
        {
          selfTrimmedPtA = new Point3d(aPtX, aPtY, aPtZ);

          OutPt.Add(selfTrimmedPtA);
        }
      }
      else
      {
        if (i == N - 1)
        {
          if ((aPtX == bPtX && bPtX == cPtX && aPtY == bPtY && bPtY == cPtY)
            || (aPtY == bPtY && bPtY == cPtY && aPtZ == bPtZ && bPtZ == cPtZ)
            || (aPtZ == bPtZ && bPtZ == cPtZ && aPtX == bPtX && bPtX == cPtX))
          {
            selfTrimmedPtA = new Point3d(aPtX, aPtY, aPtZ);
            selfTrimmedPtC = new Point3d(cPtX, cPtY, cPtZ);

            OutPt.Add(selfTrimmedPtA);
            OutPt.Add(selfTrimmedPtC);
          }
          else
          {
            selfTrimmedPtA = new Point3d(aPtX, aPtY, aPtZ);
            selfTrimmedPtB = new Point3d(bPtX, bPtY, bPtZ);
            selfTrimmedPtC = new Point3d(cPtX, cPtY, cPtZ);

            OutPt.Add(selfTrimmedPtA);
            OutPt.Add(selfTrimmedPtB);
            OutPt.Add(selfTrimmedPtC);
          }

        }
        else
        {
          if ((aPtX == bPtX && bPtX == cPtX && aPtY == bPtY && bPtY == cPtY)
            || (aPtY == bPtY && bPtY == cPtY && aPtZ == bPtZ && bPtZ == cPtZ)
            || (aPtZ == bPtZ && bPtZ == cPtZ && aPtX == bPtX && bPtX == cPtX))
          {
            selfTrimmedPtA = new Point3d(aPtX, aPtY, aPtZ);

            OutPt.Add(selfTrimmedPtA);

            i++;
          }
          else
          {
            selfTrimmedPtA = new Point3d(aPtX, aPtY, aPtZ);

            OutPt.Add(selfTrimmedPtA);
          }
        }
      }
    }
    A = OutPt;
# ---------- end c_script ----------
c_script_2 = CSharpScript(x=explode_4.Vertices)  # -> out, A; inputs x: list of Point3d
# ---------- c_script_2: C# ----------
    List<Point3d> p = new List<Point3d>();
    
    p = x;
    
    int N = x.Count - 2;
    
    List<Point3d> OutPt = new List<Point3d>();
    
    Point3d selfTrimmedPtA = new Point3d();
    Point3d selfTrimmedPtB = new Point3d();
    Point3d selfTrimmedPtC = new Point3d();

    for (int i = 0; i < N; i++)
    {
      Point3d aPt = p[i];
      Point3d bPt = p[i + 1];
      Point3d cPt = p[i + 2];


      double aPtX = p[i].X;
      double bPtX = p[i + 1].X;
      double cPtX = p[i + 2].X;

      double aPtY = p[i].Y;
      double bPtY = p[i + 1].Y;
      double cPtY = p[i + 2].Y;

      double aPtZ = p[i].Z;
      double bPtZ = p[i + 1].Z;
      double cPtZ = p[i + 2].Z;

      if (i == N - 2)
      {
        if ((aPtX == bPtX && bPtX == cPtX && aPtY == bPtY && bPtY == cPtY)
          || (aPtY == bPtY && bPtY == cPtY && aPtZ == bPtZ && bPtZ == cPtZ)
          || (aPtZ == bPtZ && bPtZ == cPtZ && aPtX == bPtX && bPtX == cPtX))
        {
          Point3d dPt = p[i + 3];

          selfTrimmedPtA = new Point3d(aPtX, aPtY, aPtZ);
          selfTrimmedPtC = new Point3d(cPtX, cPtY, cPtZ);

          OutPt.Add(selfTrimmedPtA);
          OutPt.Add(selfTrimmedPtC);
          OutPt.Add(dPt);

          i++;
        }
        else
        {
          selfTrimmedPtA = new Point3d(aPtX, aPtY, aPtZ);

          OutPt.Add(selfTrimmedPtA);
        }
      }
      else
      {
        if (i == N - 1)
        {
          if ((aPtX == bPtX && bPtX == cPtX && aPtY == bPtY && bPtY == cPtY)
            || (aPtY == bPtY && bPtY == cPtY && aPtZ == bPtZ && bPtZ == cPtZ)
            || (aPtZ == bPtZ && bPtZ == cPtZ && aPtX == bPtX && bPtX == cPtX))
          {
            selfTrimmedPtA = new Point3d(aPtX, aPtY, aPtZ);
            selfTrimmedPtC = new Point3d(cPtX, cPtY, cPtZ);

            OutPt.Add(selfTrimmedPtA);
            OutPt.Add(selfTrimmedPtC);
          }
          else
          {
            selfTrimmedPtA = new Point3d(aPtX, aPtY, aPtZ);
            selfTrimmedPtB = new Point3d(bPtX, bPtY, bPtZ);
            selfTrimmedPtC = new Point3d(cPtX, cPtY, cPtZ);

            OutPt.Add(selfTrimmedPtA);
            OutPt.Add(selfTrimmedPtB);
            OutPt.Add(selfTrimmedPtC);
          }

        }
        else
        {
          if ((aPtX == bPtX && bPtX == cPtX && aPtY == bPtY && bPtY == cPtY)
            || (aPtY == bPtY && bPtY == cPtY && aPtZ == bPtZ && bPtZ == cPtZ)
            || (aPtZ == bPtZ && bPtZ == cPtZ && aPtX == bPtX && bPtX == cPtX))
          {
            selfTrimmedPtA = new Point3d(aPtX, aPtY, aPtZ);

            OutPt.Add(selfTrimmedPtA);

            i++;
          }
          else
          {
            selfTrimmedPtA = new Point3d(aPtX, aPtY, aPtZ);

            OutPt.Add(selfTrimmedPtA);
          }
        }
      }
    }
    A = OutPt;
# ---------- end c_script_2 ----------
c_script_3 = CSharpScript(x=explode_2.Vertices)  # -> out, A; inputs x: list of Point3d; same code as c_script_2
c_script_4 = CSharpScript(x=explode.Vertices)  # -> out, A; inputs x: list of Point3d; same code as c_script_2
pline = PolyLine(Vertices=c_script.A, Closed=False)
pline_2 = PolyLine(Vertices=c_script_2.A, Closed=False)
pline_3 = PolyLine(Vertices=c_script_3.A, Closed=False)
pline_4 = PolyLine(Vertices=c_script_4.A, Closed=False)
simplify_2 = SimplifyCurve(Curve=pline)  # -> Curve, Simplified
simplify_3 = SimplifyCurve(Curve=pline_2)  # -> Curve, Simplified
simplify_4 = SimplifyCurve(Curve=pline_3)  # -> Curve, Simplified
simplify_5 = SimplifyCurve(Curve=pline_4)  # -> Curve, Simplified
explode_6 = Explode(Curve=simplify_2.Curve, Recursive=True)  # -> Segments, Vertices
explode_7 = Explode(Curve=simplify_3.Curve, Recursive=True)  # -> Segments, Vertices
explode_8 = Explode(Curve=simplify_4.Curve, Recursive=True)  # -> Segments, Vertices
explode_9 = Explode(Curve=simplify_5.Curve, Recursive=True)  # -> Segments, Vertices
points_5 = PointList(Points=explode_6.Vertices, Size="25")
points_6 = PointList(Points=explode_7.Vertices, Size="25")
points_7 = PointList(Points=explode_9.Vertices, Size="25")
points_8 = PointList(Points=explode_8.Vertices, Size="25")
